# Dynamo graph RenamePDFs.dyn (Dynamo 1.1.0.2094)

code_block = CodeBlock { "\d\w\W\w\d\d\W\d\d\w?"; }
code_block_2 = CodeBlock { "."; }

# group: Rename PDFs
# note: original file location.
directory_path = Directory("C:\Users\danny.bentley\Documents")
# note: location of files to move to.
directory_path_2 = Directory("C:\Users\danny.bentley\Documents\file move")
rename_pdfs = Custom[Rename PDFs](sourcePath=directory_path, targetPath=directory_path_2, Regular_Expression=code_block, Replace_Dash=code_block_2)  # Rename PDFs using Regular Expressions. Copy new renamed PDFs to new directory. http://revitdynamoapi.blogspot.com/2016_09_01_archive.html
watch = Watch(rename_pdfs)
regex = CodeBlock()
# ---------- regex.designscript (2 lines) ----------
// S digit ad digit
"S\d.\d.*";
# ----------------------------------------
# note: regular expression
# http://regexr.com/
regex_2 = CodeBlock()
# ---------- regex_2.designscript (2 lines) ----------
// S digit [a to z, A to Z, 0 to 9]
"S\d.[a-zA-Z0-9_.-].*";
# ----------------------------------------
